# Dynamo graph AdditionLongueur.dyn (Dynamo 2.0.1.5055)

# group: Récupère la sélection
boolean = BoolSelector(true)  # graph input
# note: Package Springs / springs node
currentSelection = Custom[Springs.Collector.CurrentSelection](refresh=boolean)  # Gets the currently selected elements. Connect a boolean switch to refresh the selection.

# group: Filtre les éléments pour ne conserver que ceux qui possèdent une longueur
string = StringInput("CURVE_ELEM_LENGTH")  # graph input
# note: Package Clockwork
byName = Custom[BuiltInParameter.ByName](searchFor=string)  # Looks up all the built-in parameters based on a given name (or part of a name) of the parameters. Search is case-insensitive.
parameterExists = Custom[Element.ParameterExists](param=byName.ParameterNames, element=currentSelection)  # Checks if an element contains a parameter of a given name
filterByBoolMask = List.FilterByBoolMask(list=currentSelection, mask=parameterExists)
firstItem = List.FirstItem(list=byName.ParameterNames)

# group: Somme longueur de tous les éléments en mètre
getParameterValueByName = Element.GetParameterValueByName(element=filterByBoolMask.in, parameterName=firstItem)
sum = Math.Sum(values=getParameterValueByName)
convert_between_units = DynamoConvert(sum, MeasurementType="Length", FromConversion="Centimeters", ToConversion="Meters")
number = DoubleInput(1)  # graph input
round = Math.Round(number=convert_between_units, digits=number)

# group: Affiche le résultat
python_script = Python(IN[0]=round)
# ---------- python_script.python (11 lines) ----------
import clr

clr.AddReference("RevitAPIUI")
from Autodesk.Revit.UI import TaskDialog

#Les entrées effectuées dans ce noeud sont stockées sous forme de liste dans les variables IN.
msg = str(IN[0]) + " m"
TaskDialog.Show("Longueur totale", msg)

#Affectez la sortie à la variable OUT.
OUT = IN
# ----------------------------------------
