# Dynamo graph AjouterDesParamètresPartagés.dyn (Dynamo 1.2.1.3083)

add_shared_parameter_to_project = Custom[Add Shared Parameter to Project]()  # This node will add a parameter to shared parameter file and then add it to the project.; unwired: Parameter_Name, Shared_Parameter_Group_Name, Paramerter_Type, Visible, Element_Category, Paramter_Group, Instance
sharedParameterFile = Parameter.SharedParameterFile()
string = StringInput("MCR_DI")
string_2 = StringInput("MCR")
select_parameter_type = ParameterType("Acceleration")
select_builtin_parameter_group = BuiltInParameterGroup("PG_AREA")
boolean = BoolSelector(true)
createSharedParameter = Parameter.CreateSharedParameter(string, string_2, select_parameter_type, select_builtin_parameter_group, boolean)  # unwired: arg5
createSharedParameterForAllCategories = Parameter.CreateSharedParameterForAllCategories(string, string_2, select_parameter_type, select_builtin_parameter_group, boolean)
code_block = CodeBlock {  }
