# Dynamo graph AjouterTaillesSegmentsTuyaux.dyn (Dynamo 1.2.0.2831)

# group: Sélection du segment de canalisation à modifier
categories = Categories("PipeSegments")
all_elements_of_category = ElementsOfCategory(categories)
string = StringInput("EN10216-1, épaisseurs série 2")
filterByName = Custom[Elements.FilterByName](elements=all_elements_of_category, searchString=string)  # Retrieves those elements from a collection whose names match the search string

# group: Aide à trouver le segment souhaité
name = Element.Name(all_elements_of_category)
watch = Watch(name)

# group: Lecture des données depuis Excel (diamètre nominal, intérieur et extérieur)
file_path = Filename("C:\FichiersLocauxRevit\DynamoTemp.xlsx")
fromPath = FileObject(file_path)  # "File.FromPath"
string_2 = StringInput("Feuil1")
readFromFile = Excel.ReadFromFile(file=fromPath, sheetName=string_2)
transpose = List.Transpose(readFromFile)
code_block = CodeBlock(x=transpose) { x[0]; x[1]; x[2]; }

# group: Écriture des nouvelles tailles de segment
ID = Custom[Element.ID](element=filterByName.first)  # Gets the ID(s) for a list of Revit elements (or a single element) - unlike the built-in Element.Id node, this node returns an actual Revit Element ID and *not* a number
python_script = Python(IN[0]=ID.ID, IN[1]=code_block.out0, IN[2]=code_block.out1, IN[3]=code_block.out2)
# ---------- python_script.python (30 lines) ----------
import clr
clr.AddReference("RevitAPI")
from Autodesk.Revit.DB import *
from Autodesk.Revit.DB.Plumbing import PipeSegment

clr.AddReference("RevitServices")
from RevitServices.Persistence import DocumentManager
from RevitServices.Transactions import TransactionManager

doc = DocumentManager.Instance.CurrentDBDocument

#Les entrées effectuées dans ce noeud sont stockées sous forme de liste dans les variables IN.
dataEnteringNode = IN

elem = doc.GetElement(IN[0])

TransactionManager.Instance.EnsureInTransaction(doc)

for dn, di, de in zip(IN[1], IN[2], IN[3]):
	DN = UnitUtils.ConvertToInternalUnits(dn , DisplayUnitType.DUT_MILLIMETERS)
	Di = UnitUtils.ConvertToInternalUnits(di , DisplayUnitType.DUT_MILLIMETERS)
	De = UnitUtils.ConvertToInternalUnits(de , DisplayUnitType.DUT_MILLIMETERS)
	try:
		elem.AddSize(MEPSize(DN,Di,De,True,True))
	except:
		elem.RemoveSize(DN)
		elem.AddSize(MEPSize(DN,Di,De,True,True))
		
#Affectez la sortie à la variable OUT.
OUT = IN
# ----------------------------------------

# group: Aperçu des données d'entrée
watch_2 = Watch(code_block.out0)
watch_3 = Watch(code_block.out1)
watch_4 = Watch(code_block.out2)

# group: Simple vérification du segment
element_name_universal = Custom[Element.Name (Universal)](element=filterByName.first)  # Gets an element's name (Dynamo's built-in Name nodes don't work for all element types, e.g. worksets...)
