# Dynamo graph AlimenterNomenclatureClef.dyn (Dynamo 1.2.1.3083)

# group: Création de la nomenclature clef si pas encore existante
categories = Categories("DetailComponents")
string = StringInput("Test2")
string_2 = StringInput("KeySchedule")
createKeySchedule = Views.Schedule.CreateKeySchedule(categories, string, string_2)

# group: Ajoute tous les paramètres commençant par la chaîne indiqué dans les champs de la nomenclature
schedulableFields = Views.Schedule.SchedulableFields(createKeySchedule)
element_name_universal = Custom[Element.Name (Universal)](element=schedulableFields)  # Gets an element's name (Dynamo's built-in Name nodes don't work for all element types, e.g. worksets...)
string_3 = StringInput("MCR")
startsWith = String.StartsWith(str=element_name_universal, searchFor=string_3)
filterByBoolMask = List.FilterByBoolMask(list=schedulableFields, mask=startsWith)
addField = Views.Schedule.AddField(createKeySchedule, filterByBoolMask.in)

# group: Ajout des données dans la nomenclature clef
code_block = CodeBlock { {1,1,1,1}; {2,2,2,2}; {3,3,3,3}; {4,4,4,4}; }
scheduleFields = Views.Schedule.ScheduleFields(addField)

create = List.Create(code_block.out0, code_block.out1, code_block.out2, code_block.out3)

# group (continued): Ajout des données dans la nomenclature clef
key_schedule = Custom[Key Schedule](ViewSchedule=addField, Data=create, Parameter_Names=scheduleFields)  # This node will take a key schedule, data and a list of parameters and populate it with infomation from data parameter. Visit www.archi-lab.net for more information on how to prep this node for take off.
