# Dynamo graph Canalisations_IsolerSelonNormeSIA.dyn (Dynamo 1.2.1.3083)

# group: Éléments isolables dans la sélection
boolean = BoolSelector(true)
éléments_isolables = Python(IN[0]=boolean)
# ---------- éléments_isolables.python (35 lines) ----------
import clr
import System

clr.AddReference("RevitNodes")
import Revit
clr.ImportExtensions(Revit.Elements)

from System.Collections.Generic import *

clr.AddReference('RevitAPI')
clr.AddReference('RevitAPIUI')
from Autodesk.Revit.DB import *

clr.AddReference("RevitServices")
from RevitServices.Persistence import DocumentManager

doc = DocumentManager.Instance.CurrentDBDocument
uidoc = DocumentManager.Instance.CurrentUIDocument

#Les entrées effectuées dans ce noeud sont stockées sous forme de liste dans les variables IN.
dataEnteringNode = IN

sel = uidoc.Selection.GetElementIds()

catList = List[BuiltInCategory]()
catList.Add(BuiltInCategory.OST_PipeFitting)
catList.Add(BuiltInCategory.OST_PipeAccessory)
catList.Add(BuiltInCategory.OST_PipeCurves)

multiCatFilter = ElementMulticategoryFilter(catList)

filteredSel = FilteredElementCollector(doc,sel).WherePasses(multiCatFilter)

#Affectez la sortie à la variable OUT.
OUT = [e.ToDSType(True) for e in filteredSel]
# ----------------------------------------

watch = Watch(éléments_isolables)

# group: Isolations du projet
element_types = ElementTypes("PipeInsulation")
all_elements_of_type = ElementsOfType(element_types)

watch_2 = Watch(all_elements_of_type)
éléments_non_isolés_isolés = Python(IN[0]=all_elements_of_type, IN[1]=éléments_isolables)
# ---------- éléments_non_isolés_isolés.python (40 lines) ----------
import clr
import System

clr.AddReference("RevitNodes")
import Revit
clr.ImportExtensions(Revit.Elements)

from System.Collections.Generic import *

clr.AddReference('RevitAPI')
clr.AddReference('RevitAPIUI')
from Autodesk.Revit.DB import *
from Autodesk.Revit.DB.Plumbing import *

clr.AddReference("RevitServices")
from RevitServices.Persistence import DocumentManager
from RevitServices.Transactions import TransactionManager

doc = DocumentManager.Instance.CurrentDBDocument
uidoc = DocumentManager.Instance.CurrentUIDocument

#Les entrées effectuées dans ce noeud sont stockées sous forme de liste dans les variables IN.
dataEnteringNode = IN

otherelem = []
insulelem = []

for elem in IN[1]:
	for i in IN[0]:
		insul = doc.GetElement(ElementId(i.Id))
		insulhostId = insul.HostElementId
		if ElementId(elem.Id) == insulhostId:
			insulelem.append([elem,i])
			break
	else:
		otherelem.append(elem)
		

#Affectez la sortie à la variable OUT.
OUT = [otherelem,insulelem]
# ----------------------------------------
code_block = CodeBlock(Elements=éléments_non_isolés_isolés) { Elements[0]; Elements[1]; }
watch_3 = Watch(code_block.out0)
element_types_2 = ElementTypes("PipeInsulationType")
all_elements_of_type_2 = ElementsOfType(element_types_2)
name = Element.Name(all_elements_of_type_2)
watch_4 = Watch(name)
watch_5 = Watch(all_elements_of_type_2)
watch_6 = Watch(code_block.out1)
boolean_2 = BoolSelector(true)
dropdownInput = Custom[DropdownInput](Run=boolean_2, Keys=name, Values=all_elements_of_type_2)  # Creates a WPF form with a dropdown for user input
python_script = Python(IN[0]=code_block.out0, IN[1]=code_block.out1, IN[2]=dropdownInput, IN[3]=dropdownInput)  # frozen
# ---------- python_script.python (57 lines) ----------
import clr

clr.AddReference('RevitAPI')
clr.AddReference('RevitAPIUI')
from Autodesk.Revit.DB import *
from Autodesk.Revit.DB.Plumbing import *

clr.AddReference("RevitServices")
from RevitServices.Persistence import DocumentManager
from RevitServices.Transactions import TransactionManager

doc = DocumentManager.Instance.CurrentDBDocument
uidoc = DocumentManager.Instance.CurrentUIDocument

#Les entrées effectuées dans ce noeud sont stockées sous forme de liste dans les variables IN.
dataEnteringNode = IN

#Affectez la sortie à la variable OUT.


pipeInsulationTypeId = ElementId(IN[2].Id)

def insulthickness(size):
	if size < UnitUtils.ConvertToInternalUnits(100 , DisplayUnitType.DUT_MILLIMETERS):
		return 10
	else:
		return 100

def connectors_maxsize(element):
	diams = []
	for e in element.ConnectorManager.Connectors:
		diams.append(e.Radius*2)
	return max(diams)

TransactionManager.Instance.EnsureInTransaction(doc)
for e in IN[0]:	
	elemId = ElementId(e.Id)
	elem = doc.GetElement(elemId)
	cms = connectors_maxsize(elem)
	it = insulthickness(cms)
	try:
		PipeInsulation.Create(doc, elemId, pipeInsulationTypeId, UnitUtils.ConvertToInternalUnits(it , DisplayUnitType.DUT_MILLIMETERS))
	except:
		raise
		
for e in IN[1]:
	elemId = ElementId(e[0].Id)
	elem = doc.GetElement(elemId)
	insulId = ElementId(e[1].Id)
	insul = doc.GetElement(insulId)
	connectors_maxsize(elem)
	try:
		pass
	except:
		raise

OUT = [cms, it]
# ----------------------------------------
parameters = Element.Parameters(code_block.out0)
boolean_3 = BoolSelector(false)
getMaterials = Element.GetMaterials(element=dropdownInput, paintMaterials=boolean_3)
byName = Material.ByName(getMaterials)
watch_7 = Watch(dropdownInput)
