# Dynamo graph CréationVues.dyn (Dynamo 2.0.1.5055)

# group: Import données csv depuis fichier sélectionné
file_path = Filename(".\CréationVues.csv")
boolean = BoolSelector(false)
importCSV = Data.ImportCSV(filePath=file_path, transpose=boolean)
code_block = CodeBlock(list=importCSV) { level=list[0]; name=list[1]; template=list[2]; param=list[3]; }

watch = Watch(importCSV)

# group: Création des niveau
# note: archilab
getLevelByName = archilab.Revit.Selection.Select.GetLevelByName(name=code_block.level)
byLevel = FloorPlanView.ByLevel(level=getLevelByName)

# group: Récupère toutes les vues
categories = Categories(index=603)
all_elements_of_category = ElementsOfCategory(Category=categories)

# group: Conserve uniquement les gabarit de vue
code_block_2 = CodeBlock(element=all_elements_of_category) { element!=null; }
filterByBoolMask = List.FilterByBoolMask(list=all_elements_of_category, mask=code_block_2)
isViewTemplate = View.IsViewTemplate(view=filterByBoolMask.in)
filterByBoolMask_2 = List.FilterByBoolMask(list=filterByBoolMask.in, mask=isViewTemplate)

# group: Création d'un dictionnaire de gabarit de vues
name = Element.Name(element=filterByBoolMask_2.in)
byKeysValues = DesignScript.Builtin.Dictionary.ByKeysValues(keys=name, values=filterByBoolMask_2.in)

# group: Application gabarit de vue
valueAtKey = DesignScript.Builtin.Dictionary.ValueAtKey(dictionary=byKeysValues, key=code_block.template)
setViewTemplate = archilab.Revit.Views.Views.SetViewTemplate(view=byLevel, viewTemplate=valueAtKey)

# group: Application valeur de tri
code_block_3 = CodeBlock { "Tri"; }
parameterByName = Parameter.ParameterByName(element=setViewTemplate, name=code_block_3)
setValue = Parameter.SetValue(parameter=parameterByName, value=code_block.param)

# group: Application nom de la vue
code_block_4 = CodeBlock { "Nom de la vue"; }
parameterByName_2 = Parameter.ParameterByName(element=setViewTemplate, name=code_block_4)
setValue_2 = Parameter.SetValue(parameter=parameterByName_2, value=code_block.name)
