# Dynamo graph CréerNomenclatureClef.dyn (Dynamo 1.2.1.3083)

categories = Categories("DetailComponents")
string = StringInput("Test")
string_2 = StringInput("KeySchedule")
createKeySchedule = Views.Schedule.CreateKeySchedule(categories, string, string_2)
code_block = CodeBlock { {"Circulateur",1}; }
code_block_2 = CodeBlock { {"MCR_DI"}; }
key_schedule = Custom[Key Schedule](ViewSchedule=createKeySchedule, Data=code_block, Parameter_Names=code_block_2)  # This node will take a key schedule, data and a list of parameters and populate it with infomation from data parameter. Visit www.archi-lab.net for more information on how to prep this node for take off.
string_3 = StringInput("Circulateur")
number = DoubleInput(1)
create = List.Create(string_3, number)
watch = Watch(create)
