# Dynamo graph DébitSpécifiéÀBouches.dyn (Dynamo 1.2.1.3083)

# group: Récupère toutes les bouches du projet
categories = Categories("DuctTerminal")
all_elements_of_category = ElementsOfCategory(categories)

# group: Filtre pour ne garder que les bouches de soufflage ou reprise selon Code Block
code_block = CodeBlock { "Classification du système"; }
getParameterValueByName = Element.GetParameterValueByName(element=all_elements_of_category, parameterName=code_block)
code_block_2 = CodeBlock { "Soufflage"; }
contains = String.Contains(str=getParameterValueByName, searchFor=code_block_2)
filterByBoolMask = List.FilterByBoolMask(list=all_elements_of_category, mask=contains)

# group: Récupère tous les espaces du projet
categories_2 = Categories("MEPSpaces")
all_elements_of_category_2 = ElementsOfCategory(categories_2)

# group: Référence les bouches qui sont dans un espace
elements_in_space = Custom[Elements in Space](Element=filterByBoolMask.in, Space=all_elements_of_category_2)  # This node will take an input of Spaces and Elements and attempt to group all elements by Room that it is located in. For elements that are placed by Line and not a Point, a mid point of line will be used to determine location.

# group: Compte le nombre de bouches par espace
count = Count(elements_in_space, lacing=Longest)

# group: Récupère le débit par espace
code_block_3 = CodeBlock { "Ecoulement de soufflage spécifié"; }
getParameterValueByName_2 = Element.GetParameterValueByName(element=all_elements_of_category_2, parameterName=code_block_3)

# group: Enlève tous les espaces ne contenant pas de bouches
code_block_4 = CodeBlock { 0; }
ne = code_block_4 != count
filterByBoolMask_2 = List.FilterByBoolMask(list=elements_in_space, mask=ne)
filterByBoolMask_3 = List.FilterByBoolMask(list=getParameterValueByName_2, mask=ne)
filterByBoolMask_4 = List.FilterByBoolMask(list=count, mask=ne)

# group: Pour chaque espace contenant plusieurs bouches la valeur est répétée afin d'avoir une liste avec un débit pour chaque bouche
div = filterByBoolMask_3.in / filterByBoolMask_4.in
ofRepeatedItem = List.OfRepeatedItem(item=div, amount=filterByBoolMask_4.in, lacing=Longest)

# group: Attribue le débit à chaque bouche
flatten = Flatten(filterByBoolMask_2.in)
code_block_5 = CodeBlock { "Flux"; }
flatten_2 = Flatten(ofRepeatedItem)
setParameterByName = Element.SetParameterByName(element=flatten, parameterName=code_block_5, value=flatten_2, lacing=Longest)

# group: Aperçu des paramètres disponibles par espace
parameters = Element.Parameters(all_elements_of_category_2)
firstItem = List.FirstItem(parameters)
watch = Watch(firstItem)

# group: Aperçu des paramètres disponibles dans les bouches
parameters_2 = Element.Parameters(all_elements_of_category)
firstItem_2 = List.FirstItem(parameters_2)
watch_2 = Watch(firstItem_2)
