# Dynamo graph EspaceÀObjet.dyn (Dynamo 2.0.1.5055)

# group: Sélection catégorie d'objet à modifier
categories = Categories(index=23)
all_elements_of_category = ElementsOfCategory(Category=categories)

# group: Sélection du paramètre cible
code_block = CodeBlock { "AAA_CFC"; }
parameterByName = Parameter.ParameterByName(element=all_elements_of_category, name=code_block)

# group: Récupération du paramètre dans l'espace
# note: Rhythm
space = Rhythm.Revit.Elements.FamilyInstances.Space(instance=all_elements_of_category)
code_block_2 = CodeBlock { "Numéro"; }
code_block_3 = CodeBlock(space=space, name=code_block_2) { space!=null?Elements.Element.GetParameterValueByName(space, name):"Aucun"; }

# group: Écriture de la valeur
setValue = Parameter.SetValue(parameter=parameterByName, value=code_block_3)
