# Dynamo graph Familles_ExporterNom.dyn (Dynamo 1.2.0.2690)

file_path = Filename("C:\Users\Nahouhak\Documents\RFTools Files\Test.xlsx")
code_block = CodeBlock { "Feuil 1"; }
code_block_2 = CodeBlock { 0; }
categories = Categories("DuctTerminal")
all_elements_of_category = ElementsOfCategory(categories)
type = FamilyInstance.Type(all_elements_of_category)
family = FamilyType.Family(type)
uniqueItems = List.UniqueItems(family)
name = Family.Name(uniqueItems)
name_2 = FamilyType.Name(uniqueItems)
create = List.Create(name, name_2, name, name_2)
transpose = List.Transpose(create)
boolean = BoolSelector(true)
writeToFile = Excel.WriteToFile(filePath=file_path, sheetName=code_block, startRow=code_block_2, startCol=code_block_2, data=transpose, overWrite=boolean)
