# Dynamo graph Family_Parameter_CreateFromExcel.dyn (Dynamo 1.2.1.3083)

file_path = Filename("C:\FichiersLocauxRevit\DynamoTemp.xlsx")
fromPath = FileObject(file_path)  # "File.FromPath"
code_block = CodeBlock { "Feuil1"; }
readFromFile = Excel.ReadFromFile(file=fromPath, sheetName=code_block)
python_script = Python(IN[0]=readFromFile)
# ---------- python_script.python (26 lines) ----------
import clr

clr.AddReference("RevitAPI")
from Autodesk.Revit.DB import *
from Autodesk.Revit.DB.Plumbing import PipeSegment
clr.AddReference("RevitServices")
from RevitServices.Persistence import DocumentManager
from RevitServices.Transactions import TransactionManager
doc = DocumentManager.Instance.CurrentDBDocument

#Les entrées effectuées dans ce noeud sont stockées sous forme de liste dans les variables IN.
dataEnteringNode = IN

TransactionManager.Instance.EnsureInTransaction(doc)
a=0
for p in IN[0]:
	try:
		doc.FamilyManager.AddParameter(p[0],
		getattr(BuiltInParameterGroup,p[1]),
		getattr(ParameterType,p[2]),
		p[3] == "True")
	except:
		pass

#Affectez la sortie à la variable OUT.
OUT = 0
# ----------------------------------------
