# Dynamo graph ObjetFiltreParParamètre.dyn (Dynamo 2.0.1.5055)

# group: Sélection catégorie d'objets
categories = Categories(index=23)
all_elements_of_category = ElementsOfCategory(Category=categories)

# group: Paramètre filtre + test logique
code_block = CodeBlock { "Flux"; }
getParameterValueByName = Element.GetParameterValueByName(element=all_elements_of_category, parameterName=code_block)
code_block_2 = CodeBlock(flux=getParameterValueByName) { flux>0; }

# group: Filtre
filterByBoolMask = List.FilterByBoolMask(list=all_elements_of_category, mask=code_block_2)

watch = Watch(filterByBoolMask.in)
watch_2 = Watch(filterByBoolMask.out)

# group: Sélectionne les objets dans Revit
boolean = BoolSelector(true)
# note: springs nodes
selectInRevit = Custom[Springs.SelectInRevit](element=filterByBoolMask.in, reset=boolean)  # Selects the input elements inside the Revit UI.
