# Dynamo graph ParamètresOpération.dyn (Dynamo 1.2.1.3083)

# group: Sélectionne tous les éléments de la catégorie
categories = Categories("MEPSpaces")
all_elements_of_category = ElementsOfCategory(categories)

# group: Liste les noms de paramètres par ordre alphabétique
firstItem = List.FirstItem(all_elements_of_category)
parameters = Element.Parameters(firstItem)
name = Parameter.Name(parameters)
sort = List.Sort(name)
watch = Watch(sort)

# group: Sélection paramètre valeur de paramètre par nom
code_block = CodeBlock { "Surface"; }
parameterByName = Parameter.ParameterByName(element=all_elements_of_category, name=code_block)
value = Parameter.Value(parameterByName)

# group: Valeur
code_block_2 = CodeBlock { 20; }

# group: Opération
code_block_3 = CodeBlock(x=value, y=code_block_2) { x*y; }

# group: Application de l'opération au paramètre cible
sélection_par_index = CodeBlock(x=watch) { x[5]; }
setParameterByName = Element.SetParameterByName(element=all_elements_of_category, parameterName=sélection_par_index, value=code_block_3)
code_block_4 = CodeBlock { "Surface"; }
parameterByName_2 = Parameter.ParameterByName(element=all_elements_of_category, name=code_block_4)

# group: Sélection de paramètre selon index de la liste
code_block_5 = CodeBlock(x=watch) { x[0]; }
parameterByName_3 = Parameter.ParameterByName(element=all_elements_of_category, name=code_block_5)
value_2 = Parameter.Value(parameterByName_3)
