# Dynamo graph PlacerInterrupteurXYZPortes.dyn (Dynamo 2.0.1.5055)

# group: Récupérer toutes les portes dans le lien sélectionné
links = Links(index=0)  # graph input
# note: Rythm
getDocument = Rhythm.Revit.Elements.RevitLink.GetDocument(linkInstance=links)
categories = Categories(index=406)  # graph input
# note: archilab
get_all_elements_from_linked = Custom[Get All Elements From Linked Model](LinkDoc=getDocument, Category=categories)  # This node is based on code posted by Julien Benoit. Big thanks to Julien for sharing his work. This node will retrieve all elements of a given category from a given linked model.

watch = Watch(get_all_elements_from_linked)

# group: Récupère position et orientation des portes
location = FamilyInstance.Location(familyInstance=get_all_elements_from_linked)
facingOrientation = FamilyInstance.FacingOrientation(familyInstance=get_all_elements_from_linked)
handOrientation = Custom[FamilyInstance.HandOrientation](familyInstance=get_all_elements_from_linked)  # Gets the hand orientation of a hosted object (e.g. a window or a door)

watch_2 = Watch(location)
watch_3 = Watch(facingOrientation)

# group: Récupère le paramètre largeur de la porte
# note: Clockwork
elementType = Custom[Element.ElementType+](element=get_all_elements_from_linked)  # Gets the family type of a given element (if applicable). Unlike the OOTB node, it also works for elements in linked models.
code_block = CodeBlock { "Largeur"; }
parameterByName = Parameter.ParameterByName(element=elementType, name=code_block)

# group: Éliminer les valeurs nulles
code_block_2 = CodeBlock { nul; }  # unwired: nul
ne = location != code_block_2
filterByBoolMask = List.FilterByBoolMask(list=location, mask=ne)
filterByBoolMask_2 = List.FilterByBoolMask(list=handOrientation, mask=ne)
filterByBoolMask_3 = List.FilterByBoolMask(list=parameterByName, mask=ne)

watch_4 = Watch(filterByBoolMask.in)
watch_5 = Watch(filterByBoolMask_2.in)
watch_6 = Watch(parameterByName)

# group: Sélection de la famille à insérer
family_types = FamilyTypes(index=184)

filterByBoolMask_4 = List.FilterByBoolMask(list=facingOrientation, mask=ne)

# group: Décalage XYZ en centimètre
value = Parameter.Value(parameter=filterByBoolMask_3.in)
X = CodeBlock { 10; }
code_block_3 = CodeBlock(largeur=value, x=X) { -(largeur/2+x); }
scale = Vector.Scale(vector=filterByBoolMask_2.in, scale_factor=code_block_3)
Y = CodeBlock { 6; }
scale_2 = Vector.Scale(vector=filterByBoolMask_4.in, scale_factor=Y)
ZAxis = Vector.ZAxis()
Z = CodeBlock { 120; }
scale_3 = Vector.Scale(vector=ZAxis, scale_factor=Z)
code_block_4 = CodeBlock(vx=scale, vy=scale_2, vz=scale_3) { Vector.Add(Vector.Add(vx,vy),vz); }

# group: Angle d'insertion de la porte
XAxis = Vector.XAxis()
ZAxis_2 = Vector.ZAxis()
angleAboutAxis = Vector.AngleAboutAxis(vector=filterByBoolMask_4.in, otherVector=XAxis, rotationAxis=ZAxis_2)

# group: Insertion de la famille et rotation
add = Point.Add(point=filterByBoolMask.in, vectorToAdd=code_block_4)
byPoint = FamilyInstance.ByPoint(familyType=family_types, point=add)
code_block_5 = CodeBlock(angle=angleAboutAxis) { angle+90; }
setRotation = FamilyInstance.SetRotation(familyInstance=byPoint, degree=code_block_5)
