# Dynamo graph RemplacementCaractèresDansNomAvecParamètre.dyn (Dynamo 1.2.0.2831)

# group: Récupère les éléments dans la sélection puis leur nom
boolean = BoolSelector(false)
currentSelection = Custom[Springs.Collector.CurrentSelection](refresh=boolean)  # Gets the currently selected elements. Connect a boolean switch to refresh the selection.

# group: Cherche le paramètre et sa valeur par son nom
string = StringInput("Abréviation")
getParameterValueByName = Element.GetParameterValueByName(element=currentSelection, parameterName=string)

# group: Cherche les caractères à remplacer dans le nom de l'élément
name = Element.Name(currentSelection)
string_2 = StringInput("HYD_CFC")
replace = String.Replace(str=name, searchFor=string_2, replaceWith=getParameterValueByName)

# group: Attribue le nom à l'élément
setName = Custom[Element.SetName](element=currentSelection, name=replace)  # Gets the name of a given Revit element

watch = Watch(setName.Success)
watch_2 = Watch(setName.Fail)
