# Dynamo graph RemplacementCaractèresDansNomNomenclature.dyn (Dynamo 1.2.0.2831)

# group: Récupère les éléments dans la sélection puis leur nom
boolean = BoolSelector(false)
currentSelection = Custom[Springs.Collector.CurrentSelection](refresh=boolean)  # Gets the currently selected elements. Connect a boolean switch to refresh the selection.
element_name_universal = Custom[Element.Name (Universal)](element=currentSelection)  # Gets an element's name (Dynamo's built-in Name nodes don't work for all element types, e.g. worksets...)

# group: Cherche les caractères à remplacer
string = StringInput(" - ")
string_2 = StringInput("_")
replace = String.Replace(str=element_name_universal, searchFor=string, replaceWith=string_2)

# group: Remplace le nom d'origine
setName = Custom[Element.SetName](element=currentSelection, name=replace)  # Gets the name of a given Revit element
