# Dynamo graph SegmentsTuyaux_Ajout.dyn (Dynamo 1.2.1.3083)

# group: Lecture des données depuis Excel (diamètre nominal, intérieur et extérieur)
file_path = Filename("C:\FichiersLocauxRevit\DynamoTemp.xlsx")
fromPath = FileObject(file_path)  # "File.FromPath"
string = StringInput("Feuil1")
readFromFile = Excel.ReadFromFile(file=fromPath, sheetName=string)
transpose = List.Transpose(readFromFile)
code_block = CodeBlock(x=transpose) { x[0]; x[1]; x[2]; }

# group: Aperçu des données d'entrée
watch = Watch(code_block.out0)
watch_2 = Watch(code_block.out1)
watch_3 = Watch(code_block.out2)

# group: Nom du segment et matériau à appliquer
string_2 = StringInput("soudés selon EN 10255, Série M")
string_3 = StringInput("Acier, S 195T")
byName = Material.ByName(string_3)
ID = Custom[Element.ID](element=byName)  # Gets the ID(s) for a list of Revit elements (or a single element) - unlike the built-in Element.Id node, this node returns an actual Revit Element ID and *not* a number

# group: Écriture des nouvelles tailles de segment
python_script = Python(IN[0]=code_block.out0, IN[1]=code_block.out1, IN[2]=code_block.out2, IN[3]=string_2, IN[4]=ID.ID)
# ---------- python_script.python (42 lines) ----------
import clr
clr.AddReference("RevitAPI")
from Autodesk.Revit.DB import *
from Autodesk.Revit.DB.Plumbing import PipeSegment
from Autodesk.Revit.DB.Plumbing import PipeScheduleType

clr.AddReference("RevitServices")
from RevitServices.Persistence import DocumentManager
from RevitServices.Transactions import TransactionManager

from System.Collections.Generic import *

doc = DocumentManager.Instance.CurrentDBDocument

#Les entrées effectuées dans ce noeud sont stockées sous forme de liste dans les variables IN.
dataEnteringNode = IN

TransactionManager.Instance.EnsureInTransaction(doc)

try:
	pipeschedule = PipeScheduleType.Create(doc,IN[3])
except:
	psId  = PipeScheduleType.GetPipeScheduleId(doc, IN[3])
	doc.Delete(psId)
	pipeschedule = PipeScheduleType.Create(doc,IN[3])
	
psId = pipeschedule.Id

matId = IN[4]

mepsizes = List[MEPSize]()

for dn, di, de in zip(IN[0], IN[1], IN[2]):
	DN = UnitUtils.ConvertToInternalUnits(dn , DisplayUnitType.DUT_MILLIMETERS)
	Di = UnitUtils.ConvertToInternalUnits(di , DisplayUnitType.DUT_MILLIMETERS)
	De = UnitUtils.ConvertToInternalUnits(de , DisplayUnitType.DUT_MILLIMETERS)
	mepsizes.Add(MEPSize(DN, Di, De, True, True))
	
PipeSegment.Create(doc, matId, psId, mepsizes)	
		
#Affectez la sortie à la variable OUT.
OUT = IN
# ----------------------------------------

watch_4 = Watch(python_script)
