# Dynamo graph Vues_RemplacerCaractères.dyn (Dynamo 1.2.1.3083)

# group: Cherche toutes les vues du type choisi
view_type = ViewTypesUI("FloorPlan")
getByType = Views.View.GetByType(view_type)

# group: Cherche la chaîne de caractère dans le nom actuel et la remplace par une autre chaîne
element_name_universal = Custom[Element.Name (Universal)](element=getByType)  # Gets an element's name (Dynamo's built-in Name nodes don't work for all element types, e.g. worksets...)
code_block = CodeBlock { " - "; }
code_block_2 = CodeBlock { "_"; }
replace = String.Replace(str=element_name_universal, searchFor=code_block, replaceWith=code_block_2)

# group: Action
setName = Custom[Element.SetName](element=getByType, name=replace)  # Gets the name of a given Revit element

# group: Visuel du résultat
element_name_universal_2 = Custom[Element.Name (Universal)](element=setName.Success)
watch = Watch(element_name_universal_2)

type = Elements.Element.Type(getByType)

# group: Cherche la chaîne de caractère dans le nom actuel et la remplace par une autre chaîne
element_name_universal_3 = Custom[Element.Name (Universal)](element=type)
code_block_3 = CodeBlock { "_COO"; }
code_block_4 = CodeBlock { "_GEN"; }
replace_2 = String.Replace(str=element_name_universal_3, searchFor=code_block_3, replaceWith=code_block_4)

# group: Action
setName_2 = Custom[Element.SetName](element=type, name=replace_2)

# group: Visuel du résultat
element_name_universal_4 = Custom[Element.Name (Universal)](element=setName_2.Success)
watch_2 = Watch(element_name_universal_4)
