# Dynamo graph Vues_Renommer.dyn (Dynamo 1.2.1.3083)

# group: Liste toutes les vues du même type que celle sélectionnée
views = Custom[Document.Views]()  # Gets all views in the document - except for 3D view templates (as long as this bug is not fixed: https://github.com/DynamoDS/Dynamo/issues/2970)
views_2 = Views("ENE_SRE_Plan")
type = Object.Type(views_2)

view_type = ViewTypesUI("FloorPlan")
getByType = Views.View.GetByType(view_type)

# group: Exclusion des gabarits de vue
removeIfNot = RemoveIfNot(views, getByType)
isViewTemplate = Custom[View.IsViewTemplate](view=removeIfNot)  # Checks if a given view is a view template
filterByBoolMask = List.FilterByBoolMask(list=removeIfNot, mask=isViewTemplate)  # frozen

# group: Cherche le nom du gabarit de vue associé à la vue
viewTemplate = Custom[View.ViewTemplate](view=filterByBoolMask.out)  # Returns the view template assigned to a given view (if one is assigned)
element_name_universal = Custom[Element.Name (Universal)](element=viewTemplate)  # Gets an element's name (Dynamo's built-in Name nodes don't work for all element types, e.g. worksets...)

# group: Cherche le nom du niveau associé de la vue
level = Custom[Element.Level](element=filterByBoolMask.out)  # Gets an element's level
name = Level.Name(level)

# group: Cherche le nom de la zone de définition de la vue
firstItem = List.FirstItem(filterByBoolMask.out)
get_family_parameter = FamilyInstanceParameters(firstItem)
getParameterValueByName = Element.GetParameterValueByName(element=filterByBoolMask.out, parameterName=get_family_parameter)
element_name_universal_2 = Custom[Element.Name (Universal)](element=getParameterValueByName)
string = StringInput("ENS")
replaceEmptyLists = Custom[List.ReplaceEmptyLists](seq=element_name_universal_2, Replacement=string)  # Replaces all empty lists within a given list with a substitute

# group: Rassemble les différentes chaînes de caractères avec le séparateur indiqué entre chaque. La vue prend le nom de cette chaîne.
string_2 = StringInput("_")
create = List.Create(element_name_universal, name, replaceEmptyLists)
transpose = List.Transpose(create)
join = String.Join(string_2, transpose)
setName = Custom[Element.SetName](element=filterByBoolMask.out, name=join)  # Gets the name of a given Revit element

# group: Renommer gabarits de vue
element_name_universal_3 = Custom[Element.Name (Universal)](element=filterByBoolMask.in)  # frozen
code_block = CodeBlock { " - "; }
code_block_2 = CodeBlock { "_"; }
replace = String.Replace(str=element_name_universal_3, searchFor=code_block, replaceWith=code_block_2)
setName_2 = Custom[Element.SetName](element=filterByBoolMask.in, name=replace)

# group: Renommer type de vue
type_2 = Elements.Element.Type(filterByBoolMask.out)  # frozen
element_name_universal_4 = Custom[Element.Name (Universal)](element=type_2)
code_block_3 = CodeBlock { " - "; }
code_block_4 = CodeBlock { "_"; }
replace_2 = String.Replace(str=element_name_universal_4, searchFor=code_block_3, replaceWith=code_block_4)
setName_3 = Custom[Element.SetName](element=type_2, name=replace_2)
