# Dynamo graph csvÀRevit.dyn (Dynamo 2.0.1.5055)

# group: Sélection du fichier
file_path = Filename("E:\Bureau\DeuxPortes.csv")

# group: Lecture du fichier csv
boolean = BoolSelector(false)
importCSV = Data.ImportCSV(filePath=file_path, transpose=boolean)
code_block = CodeBlock(liste=importCSV) { liste[0]; liste[1]; }

watch = Watch(importCSV)

# group: Sélection des objets par identifiant
# note: Clockwork
byID = Custom[Element.ByID](ID_UniqueId_var_var=code_block.out0)  # Gets the Revit element(s) for a list of IDs (or a single ID). Optionally retrieves elements from linked documents as well.

# group: Écriture dans le paramètre indiqué
code_block_2 = CodeBlock { "Commentaires"; }
setParameterByName = Element.SetParameterByName(element=byID, parameterName=code_block_2, value=code_block.out1)
